# Grasshopper definition abb_robot_control.gh (Grasshopper 1.0.7)

# ---- group: ROS client
# ABB client
restart = Button()
connect = Button()
disconnect = Button()
ros = PythonScript(restart=restart)  # -> out, abb_client
# ---------- ros: Python ----------
import sys
import time
import logging
import scriptcontext as sc

from compas_fab.backends import RosClient

from compas_rrc import AbbClient

from System import TimeSpan
from System.Threading import ManualResetEventSlim

LOGGER = logging.getLogger('roslibpy')

key = 'rosclient_%s' % str(ghenv.Component.InstanceGuid)
previous_client = sc.sticky.get(key, None)
if previous_client:
    previous_client.terminate()


abb_client = AbbClient(RosClient('localhost', 9090))
sc.sticky[key] = abb_client

waitLock = ManualResetEventSlim(False)

abb_client.ros.on_ready(lambda: waitLock.Set())

if not waitLock.Wait(TimeSpan.FromSeconds(5)):
    raise Exception('Unable to connect to ROS')

LOGGER.info('ROS connection opened')
# ---------- end ros ----------
connect_2 = PythonScript(abb_client=ros.abb_client, connect=connect, disconnect=disconnect)  # -> out, abb_client
# ---------- connect_2: Python ----------
import logging
from System import TimeSpan
from System.Threading import ManualResetEventSlim

LOGGER = logging.getLogger('roslibpy')
ros_client = abb_client.ros
if connect:
    if not ros_client.is_connected:
        LOGGER.debug('Connecting...')
        waitLock = ManualResetEventSlim(False)
        ros_client.on_ready(lambda: waitLock.Set())
        ros_client.connect()

        if not waitLock.Wait(TimeSpan.FromSeconds(5)):
            raise Exception('Unable to connect to ROS')
        LOGGER.debug('Reconnected')

if disconnect:
    if ros_client.is_connected:
        ros_client.terminate()
        LOGGER.debug('Terminated')
# ---------- end connect_2 ----------

# ---- group: Docker
# Container status
list = ValueList({"Virtual": "virtual", "Real": "real"}, selected="Virtual")
python = GhPythonScript(run=Button())  # -> out, status; inputs run: Boolean
# ---------- python: Python ----------
from scriptcontext import sticky

from subprocess import Popen
from subprocess import PIPE, STDOUT

from datetime import datetime

cmd = ["docker", "ps","--all", "--format", "\"{{.Names}}: {{.Status}}\""]

sticky["docker_ps_run"] = False

if run:
    sticky["docker_ps_run"] = True

if sticky["docker_ps_run"]:
    proc = Popen(cmd, stdout=PIPE, stderr=STDOUT, universal_newlines= True, shell=True)
    sticky["docker_status"], _ = proc.communicate()
    sticky["docker_ps_run"] = False

if "docker_status" in sticky.keys():
    last_check = "Last check at: {time}\n\n".format(time=datetime.now().strftime("%H:%M:%S"))
    status  = last_check + sticky["docker_status"]
# ---------- end python ----------
python_2 = GhPythonScript(target=list, start_all=Button(), recreate_abb_driver=Button(), stop_driver=Button(), stop_all=Button())  # -> out
# ---------- python_2: Python ----------
from compas_rcf.docker import compose_up
from compas_rcf.docker import compose_down

from compas_rcf.abb import ROBOT_IPS
from compas_rcf.abb import DOCKER_COMPOSE_PATHS

if target is None:
    target = "virtual"

ip = {"ROBOT_IP": ROBOT_IPS[target]}

if start_all:
    try:
        a = (compose_up(DOCKER_COMPOSE_PATHS["base"]))
        compose_up(DOCKER_COMPOSE_PATHS["driver"], env_vars=ip)
    except CalledProcessError:
        print("please, remove dead docker containers manually and try again")

if recreate_abb_driver:
    compose_up(DOCKER_COMPOSE_PATHS["driver"], force_recreate=True, env_vars=ip)

if stop_driver:
    compose_down(DOCKER_COMPOSE_PATHS["driver"])

if stop_all:
    compose_down(DOCKER_COMPOSE_PATHS["driver"])
    compose_down(DOCKER_COMPOSE_PATHS["base"])
# ---------- end python_2 ----------
status = Panel(python.status)

# ----
a6 = Slider(0, range=-360..360)
a1 = Slider(0, range=-360..360)
a4 = Slider(0, range=-360..360)
a5 = Slider(0, range=-360..360)
a2 = Slider(0, range=-360..360)
a3 = Slider(0, range=-360..360)
forward_kinematics = PythonScript(a1=a1, a2=a2, a3=a3, a4=a4, a5=a5, a6=a6)  # -> configuration
# ---------- forward_kinematics: Python ----------
import math

joint_positions = [a1, a2, a3, a4, a5, a6]
configuration = [math.radians(a) for a in joint_positions]
# ---------- end forward_kinematics ----------

error_message = Panel(python_2)
pt = Point(Point(2090.158508, 222.4327358, 703.6954429))
pt_2 = Point(Point(2382.886967, 923.8764019, 703.6954429))
xy = XYPlane(Origin=pt)
xz = XZPlane(Origin=pt_2)
bang = Button()
pflip = FlipPlane(Plane=xy, ReverseX=False, ReverseY=False, SwapAxes=True)
list_2 = ValueList({"MoveJ": True, "MoveL": False}, selected="MoveL")
unload = PythonScript(bang=bang, module="compas_rcf")
# ---------- unload: Python ----------
import sys

def unload_modules(top_level_module_name):
    """Unloads all modules named starting with the specified string.

    This function eases the development workflow when editing a library that is
    used from Rhino/Grasshopper.

    Args:
        top_level_module_name (:obj:`str`): Name of the top-level module to unload.

    Returns:
        list: List of unloaded module names.
    """
    modules = filter(lambda m: m.startswith(top_level_module_name), sys.modules)

    for module in modules:
        sys.modules.pop(module)

    return modules

unload_modules(module)
# ---------- end unload ----------

# ---- group: MoveJ to Frame
# Move to plane
python_3 = GhPythonScript(client=connect_2.abb_client, planes=pflip, motion_type=list_2, run=Button())  # -> out; inputs planes: list of Plane, motion_type: Boolean, speed: Int32, run: Boolean
# ---------- python_3: Python ----------
from compas_rrc import MoveToFrame
from compas_rrc import SetAcceleration
from compas_rrc import SetMaxSpeed
from compas_rrc import SetTool
from compas_rrc import SetWorkObject
from compas_rrc import Zone
from compas_rrc import Motion

from compas_rcf.utils.util_funcs import ensure_frame

if tool_name is None:
    tool_name = "tool0"
if wobj_name is None:
    wobj_name = "wobj0"
if speed is None:
    speed = 100

if motion_type is None:
    motion = Motion.JOINT
elif motion_type:
    motion = Motion.JOINT
else:
    motion = Motion.LINEAR

if run:
    if not client.ros.is_connected:
        raise Exception("Not connected to ROS")
        
    client.send(SetTool(tool_name))
    client.send(SetWorkObject(wobj_name))
    client.send(SetAcceleration(100, 100))
    client.send(SetMaxSpeed(100, 150))
    
    for plane in planes:
        frame = ensure_frame(plane)
        client.send(MoveToFrame(frame,
                                 speed,
                                 Zone.FINE,
                                 motion))
# ---------- end python_3 ----------

# Get joint configuration and frame
python_4 = GhPythonScript(client=connect_2.abb_client, run=Button())  # -> out, plane, joint_values; inputs run: Boolean
# ---------- python_4: Python ----------
from ghpythonlib.treehelpers import list_to_tree
from scriptcontext import sticky

from compas_rrc import GetFrame
from compas_rrc import GetJoints

from compas_rcf.rhino import cgframe_to_rgplane

TIMEOUT = 5 
TIMEOUT_LONG = 30 

if run:
    if not client.ros.is_connected:
        raise Exception("Not connected to ROS")
        
    sticky["frame"] = client.send_and_wait(GetFrame(), timeout=TIMEOUT)
    
    sticky["joint_values"], _ = client.send_and_wait(GetJoints(), timeout=TIMEOUT)

if "frame" in sticky.keys():
    plane = cgframe_to_rgplane(sticky["frame"])

if "joint_values" in sticky.keys():
    joint_values = list_to_tree(sticky["joint_values"])
# ---------- end python_4 ----------

# Move to joint configuration
python_5 = GhPythonScript(client=connect_2.abb_client, configuration=forward_kinematics, run=Button())  # -> out; inputs configuration: list, run: Boolean
# ---------- python_5: Python ----------
from compas_rrc import SetAcceleration
from compas_rrc import SetMaxSpeed
from compas_rrc import MoveToJoints
from compas_rrc import Zone

from compas_rcf.utils.util_funcs import ensure_frame

TIMEOUT = 5 
TIMEOUT_LONG = 30 

if speed is None:
    speed = 100

if run:
    if not client.ros.is_connected:
        raise Exception("Not connected to ROS")

    client.send(SetAcceleration(100, 100))
    client.send(SetMaxSpeed(100, 150))

    client.send_and_wait(
                          MoveToJoints(configuration,
                                        [],
                                        speed,
                                        Zone.FINE,
                                        ),
                          timeout=TIMEOUT_LONG)
# ---------- end python_5 ----------

# ----
panel = Panel(python_4.joint_values)
pln = Plane(python_4.plane)
